# Dynamo graph NombreHabitaciones.dyn (Dynamo 3.6.2.11575)

file_path = Filename("D:\3. DOCENCIA\3.6 USUR\Inteligencia Artificial\Habitaciones.xlsx")  # graph input
string = StringInput("Metrados")  # graph input

# group: Paso 01: Seleccionar la categoría
categories = Categories("OST_Rooms")  # graph input
all_elements_of_category = ElementsOfCategory(Category=categories)

# note: Seleccionar el tipo de cateogoría deseada
code_block = CodeBlock { "Comentarios"; }
getParameterValueByName = Element.GetParameterValueByName(element=all_elements_of_category, parameterName=code_block)
count = List.Count(list=getParameterValueByName)
code_block_2 = CodeBlock(n=count) { 1..n; }
code_block_3 = CodeBlock(i=code_block_2) { "A-"+i; }
setParameterByName = Element.SetParameterByName(element=all_elements_of_category, parameterName=code_block, value=code_block_3)
name = Room.Name(room=setParameterByName)
number = Room.Number(room=setParameterByName)
area = Room.Area(room=setParameterByName)
code_block_4 = CodeBlock { 2; }
round = Math.Round(number=area, digits=code_block_4)
list_create = List.Create(item0=name, item1=number, item2=round)
transpose = List.Transpose(lists=list_create)
openXMLExportExcel = Data.OpenXMLExportExcel(filePath=file_path, sheetName=string, data=transpose)
